# Grasshopper definition mesh1.gh (Grasshopper 1.0.7)
# plug-ins: MeshEdit Components, Bifocals, Weaverbird

# Base Mesh
mesh = Mesh([<mesh referenced from the Rhino model> x184])
mesh_2 = Mesh([<mesh referenced from the Rhino model> x87])
mesh_explode = MeshExplode(Mesh=mesh, Interpolate=False)  # -> flatten(Faces)
mesh_join = MeshJoin(Meshes=mesh_2)
face_normals = FaceNormals(Mesh=mesh_explode)  # -> flatten(Centers), Normals
mesh_weldvertices = MeshWeldVertices(Mesh=mesh_join, Tolerance=0.01)  # -> RuntimeMessage, Mesh
cull_duplicates = CullDuplicates(Points=face_normals.Centers, Tolerance=0.1, CullMode=2)  # -> Points, Indices, Valence
panel = Panel(mesh_weldvertices.Mesh)
list_item = ListItem(List=mesh_explode, Index=cull_duplicates.Indices, Wrap=True)
mesh_join_2 = MeshJoin(Meshes=list_item)

wbcatmullclark = WeaverbirdsCatmullClarkSubdivision(MeshCurves=mesh_weldvertices.Mesh, Level=Slider(2, range=1..3), SmoothNakedEdges=Slider(2, range=0..2))

mesh_3 = Mesh(mesh_join_2)
vertex_offset = Slider(50, range=0..250)

# ---- group: component
mesh_4 = Mesh(<mesh referenced from the Rhino model>)
mesh_explode_2 = MeshExplode(Mesh=mesh_4, Interpolate=False)  # -> flatten(Faces)
face_normals_2 = FaceNormals(Mesh=mesh_explode_2)  # -> flatten(Centers), Normals
cull_duplicates_2 = CullDuplicates(Points=face_normals_2.Centers, Tolerance=0.1, CullMode=2)  # -> Points, Indices, Valence
list_item_2 = ListItem(List=mesh_explode_2, Index=cull_duplicates_2.Indices, Wrap=True)
mesh_join_3 = MeshJoin(Meshes=list_item_2)
mesh_5 = Mesh(mesh_join_3)

# ----
# reference bounding box
crv = Curve([<curve referenced from the Rhino model> x6])
bbox = BoundingBox(Content=crv, Plane=PlaneXY(0, 0, 0), UnionBox=True)  # -> Box, Box_2

panel_2 = Panel(mesh_5)

normals_size = Slider(297.271, range=0..2000)

demesh = DeconstructMesh(Mesh=wbcatmullclark)  # -> Vertices, Faces, Colours, Normals
# move vertices and sort them by face
deface = DeconstructFace(Face=graft(demesh.Faces))  # -> CornerA, CornerB, CornerC, CornerD
merge = Merge(Data1=deface.CornerA, Data2=deface.CornerB, Data3=deface.CornerC, Data4=deface.CornerD)
item = ListItem(List=demesh.Vertices, Index=merge, Wrap=True)  # -> simplify(Item)

# ----
# show vertex normals
multiplication = Multiplication(A=demesh.Normals, B=normals_size)
vdisex = VectorDisplayEx(Point=demesh.Vertices, Vector=multiplication, Colour=RGB(0, 0, 0), Width=2)

amp = Amplitude(Vector=demesh.Normals, Amplitude=vertex_offset)
move = Move(Geometry=demesh.Vertices, Motion=amp)  # -> Geometry, Transform

item_2 = ListItem(List=move.Geometry, Index=merge, Wrap=True)  # -> simplify(Item)

merge_2 = Merge(Data1=item, Data2=item_2)

# ----
# create twisted boxes
item_3 = ListItem(List=merge_2, Index=0, Wrap=True)  # -> Item, Item1, Item2, Item3, Item4, Item5, Item6, Item7
tbox = TwistedBox(
    CornerA=item_3.Item,
    CornerB=item_3.Item1,
    CornerC=item_3.Item2,
    CornerD=item_3.Item3,
    CornerE=item_3.Item4,
    CornerF=item_3.Item5,
    CornerG=item_3.Item6,
    CornerH=item_3.Item7)  # -> flatten(TwistedBox)

morph = BoxMorph(Geometry=mesh_5, Reference=bbox.Box, Target=tbox)

mjoin = MeshJoin(Meshes=flatten(morph))
weldvertices = MeshWeldVertices(Mesh=mjoin, Tolerance=0.01)  # -> RuntimeMessage, Mesh

medges = MeshEdges(Mesh=weldvertices.RuntimeMessage)  # -> NakedEdges, InteriorEdges, NonManifoldEdges
preview = CustomPreview(Geometry=weldvertices.RuntimeMessage, Material=ColourSwatch(SwatchColor=RGB(181, 209, 138)))
preview_2 = CustomPreview(Geometry=medges.NonManifoldEdges, Material=ColourSwatch(SwatchColor=RGB(0, 0, 0)))
